# Dynamo graph replacer.dyn (Dynamo 0.9.0.3067)

family_types = FamilyTypes("BCRA_Break Line:BCRA_Break Line")
all_elements_of_family_type = ElementsOfFamilyType(family_types)
elementLocation = Custom[ElementLocation](element=all_elements_of_family_type)  # Returns the location of an element as an XYZ (or if it's line-based the start and end point of the line), along with some booleans to help filtering the results. Use this for some element types (e.g. walls or lines) that do not work with the built-in Get Family Instance Location node.
XAxis = Vector.XAxis()
XY = Plane.XY()
radiansToDegrees = Math.RadiansToDegrees(elementLocation.rotation)
rotate = Vector.Rotate(XAxis, XY, radiansToDegrees)
reverse = Vector.Reverse(rotate)
string = StringInput("Left")
getParameterValueByName = Element.GetParameterValueByName(element=all_elements_of_family_type, parameterName=string)
code_block = CodeBlock(x=getParameterValueByName) { x-0.125; }
translate = Geometry.Translate(geometry=elementLocation.points, direction=reverse, distance=code_block)
string_2 = StringInput("Right")
getParameterValueByName_2 = Element.GetParameterValueByName(element=all_elements_of_family_type, parameterName=string_2)
code_block_2 = CodeBlock(x=getParameterValueByName_2) { x-0.125; }
translate_2 = Geometry.Translate(geometry=elementLocation.points, direction=rotate, distance=code_block_2)
byStartPointEndPoint = Line.ByStartPointEndPoint(startPoint=translate, endPoint=translate_2)
family_types_2 = FamilyTypes("b.Breakline-zigzag-open:b.Breakline-zigzag-open")
getViewOfElement = Custom[GetViewOfElement]()  # Get the view in which a detail item is placed
map = List.Map(list=all_elements_of_family_type, f_x=getViewOfElement)
byCurve = Custom[DetailComponent.ByCurve](curve=byStartPointEndPoint, familyType=family_types_2, view=map)  # Places a line-based detail component in a given view
string_3 = StringInput("Height")
string_4 = StringInput("Masking depth")
getParameterValueByName_3 = Element.GetParameterValueByName(element=all_elements_of_family_type, parameterName=string_4)
setParameterByName = Element.SetParameterByName(element=byCurve, parameterName=string_3, value=getParameterValueByName_3)
